# Grasshopper definition TestVase.ghx (Grasshopper 1.0.8)
# plug-ins: ClayBESO

# ----
# Vase design
number_slider = Slider(6.08, range=0..20)
pt = ConstructPoint(XCoordinate=0, YCoordinate=0, ZCoordinate=Slider(3.2, range=0..20))
pt_2 = ConstructPoint(XCoordinate=0, YCoordinate=0, ZCoordinate=number_slider)
ellipse = Ellipse(Plane=PlaneXY(0, 0, 0), Radius1=1, Radius2=Slider(2, range=0..10))  # -> Ellipse, Focus1, Focus2
ellipse_2 = Ellipse(Plane=pt, Radius1=Slider(6, range=0..10), Radius2=1)  # -> Ellipse, Focus1, Focus2
ellipse_3 = Ellipse(Plane=pt_2, Radius1=1, Radius2=Slider(2, range=0..10))  # -> Ellipse, Focus1, Focus2
entwine = Entwine(Branch00=ellipse.Ellipse, Branch01=ellipse_2.Ellipse, Branch02=ellipse_3.Ellipse, FlattenInputs=True)  # -> flatten(Result)
number_slider_2 = Slider(40, range=0..100)
loft = Loft(Curves=entwine, Options={Adjust=False, Closed=False, LoftEnds=0, LoftSimp=0, LoftType=0, Rebuild=10, Refit=0.01})
scale = Scale(Geometry=loft, Center="0,0,0", Factor="10")  # -> Geometry, Transform
mesh_uv = MeshSurface(Surface=scale.Geometry, UCount=number_slider_2, VCount=number_slider_2, Overhang=True, Equalize=False)

tri = Triangulate(Mesh=mesh_uv)  # -> Mesh, Count

# ----
# Extract ave. edge length
medges = MeshEdges(Mesh=tri.Mesh)  # -> NakedEdges, InteriorEdges, NonManifoldEdges
entwine_2 = Entwine(Branch00=medges.NakedEdges, Branch01=medges.InteriorEdges, Branch02=medges.NonManifoldEdges, FlattenInputs=True)  # -> flatten(Result)
len = Length(Curve=entwine_2)
avr = Average(Input=len)
multiplication = Multiplication(A=avr, B="2.5")

shell = ShellModel(Mesh=tri.Mesh, Thickness=5, FixBase=True, FixRotations=True, Tolerance=0.5, SelfWeight=True, GravityFactor=1)  # -> Model, Mesh, Supports, Info
get_help = Button()
rule = LayerRule(Mapping=3, MinLayerHeight=1, MaxLayerHeight=2.5, BeadArea=0, AspectRatio=0.4, ThicknessRange="3.5 to 7")
wall = WallPreview(Model=shell.Model)

# ----
# Run BESO -
# thickness optimisation
number_slider_3 = Slider(1, range=0..1)
beso = ShellBESO(
    Model=shell.Model,
    Mode=0,
    VolumeFraction=0,
    MinThickness=3.5,
    MaxThickness=7,
    EvolutionRate=0.03,
    FilterRadius=multiplication,
    MaxIterations=100,
    Run=Toggle(False),
    Reset=Button(),
    Penalty=3,
    AdmissionRatio=0.02,
    Legend=True,
    Playback=number_slider_3,
    LayerRule=rule,
    BondEfficiency=1)  # -> Thickness, Solid, Sensitivity, Preview, Compliance, Volume, Iteration, Converged, Info

help = Help(Open=get_help)  # -> URL, Version
converged = Panel(beso.Converged)
release_version = Panel(help.Version)

# ----
# Show layer height
layerh = LayerHeights(
    Model=shell.Model,
    Thickness=beso.Thickness,
    MinLayerHeight=1,
    MaxLayerHeight=2.5,
    Mapping=0,
    BeadArea=0,
    Smoothing=5,
    AspectRatio=0.4,
    Legend=True,
    LayerRule=rule)  # -> LayerHeights, VertexThickness, BeadArea, Preview

# ----
# vonMises -
# Before BESO
analyse = ShellAnalysis(Model=shell.Model, DeformScale=10, Legend=True, BondEfficiency=1)  # -> Compliance, MaxDisplacement, Displacements, VonMises, Utilisation, Preview, Info, MaxStressPoint

# ----
# vonMises -
# After BESO
analyse_2 = ShellAnalysis(Model=shell.Model, Thickness=beso.Thickness, DeformScale=10, Legend=True, LayerRule=rule, BondEfficiency=1)  # -> Compliance, MaxDisplacement, Displacements, VonMises, Utilisation, Preview, Info, MaxStressPoint

# ----
# Show layer height contours
layers = NonPlanarLayers(
    Model=shell.Model,
    LayerHeights=layerh.LayerHeights,
    Method=0,
    Vertical=True,
    Tolerance=0.5,
    Seam=Vector(1, 0, 0),
    NominalArea=0,
    Legend=True)  # -> Layers, TargetHeight, RealisedHeight, Width, LayerField, LayerCount, Preview, Info, BeadArea, FlowFactor

preview = CustomPreview(Geometry=layers.Layers, Material=ColourSwatch(SwatchColor=RGB(0, 0, 0)))
